# Dynamo graph Home7.dyn (Dynamo 1.3.0.875)

file_path = Filename("C:\Program Files\Oasys\GSA 8.7\Samples\Stair.gwb")
openGsaModel = DynaGsa.OpenGsa.OpenGsaModel(file_path)
code_block = CodeBlock { "all"; }
coordinates = DynaGsa.Commands.Coordinates(openGsaModel, code_block)
openModelo = DynaGsa.OpenGsa.OpenModelo(file_path)
code_block_2 = CodeBlock()
# ---------- code_block_2.designscript (17 lines) ----------
"
using Interop.gsa_8_7;
using System;

        public static ComAuto OpenModelo(string filePath)
        {
            ComAuto GsaObj = new ComAuto();
            string file = filePath.ToString();
            GsaObj.SetLocale(Locale.LOC_EN_GB);
            GsaObj.Open(file);
            return GsaObj;
        }


OpenModelo(IN[0])

";
# ----------------------------------------
file_path_2 = Filename("C:\Program Files\Oasys\GSA 8.7\Interop.Gsa_8_7.dll")
fromString = Scripting.CSharpScript.FromString(arg1=file_path, arg2=file_path_2)  # unwired: arg0
