# Dynamo graph Home.dyn (Dynamo 1.3.0.875)

file_path = Filename("C:\Program Files\Oasys\GSA 8.7\Samples\Stair.gwb")
openModel = DynaGsa.OpenGsa.OpenModel(file_path)
code_block = CodeBlock()
# ---------- code_block.designscript (18 lines) ----------
"
using Interop.gsa_8_7;



        public static ComAuto OpenModel(string filePath)
        {
            ComAuto GsaObj = new ComAuto();

            GsaObj.SetLocale(Locale.LOC_EN_GB);
            GsaObj.Open(filePath.ToString());
            return GsaObj as ComAuto;
        }

OpenModel(IN[0].ToString())


        ";
# ----------------------------------------
file_path_2 = Filename("C:\Program Files\Oasys\GSA 8.7\Interop.Gsa_8_7.dll")
fromString = Scripting.CSharpScript.FromString(code_block, file_path, file_path_2)
type = Object.Type(fromString)
code_block_2 = CodeBlock()
# ---------- code_block_2.designscript (18 lines) ----------
"
using System;
using System.Collections.Generic;
using Interop.gsa_8_7;
using Autodesk.DesignScript.Geometry;


public static ComAuto Coordinates(ComAuto GsaObj)
        {

  return GsaObj as ComAutoClass;

  }



Coordinates(IN[0] as ComAuto)
        ";
# ----------------------------------------
fromString_2 = Scripting.CSharpScript.FromString(code_block_2, fromString, file_path_2)
code_block_3 = CodeBlock { "all"; }
coordinates = DynaGsa.Commands.Coordinates(fromString_2, code_block_3)
code_block_4 = CodeBlock()
# ---------- code_block_4.designscript (37 lines) ----------
"
using System;
using System.Collections.Generic;
using Interop.gsa_8_7;
using Autodesk.DesignScript.Geometry;


public static List<Point> Coordinates(ComAuto GsaObj, string sList)
        {

            int[] NodeRefs = null;

            short s = GsaObj.EntitiesInList(sList, GsaEntity.NODE, out NodeRefs);

            Array.Sort(NodeRefs);

            List<Point> PtList = new List<Point>();


            GsaNode[] Nodes;


            //Get node coordinates
            short t = GsaObj.Nodes(NodeRefs, out Nodes);

            foreach (GsaNode item in Nodes)
            {

                PtList.Add(Point.ByCoordinates(item.Coor[0], item.Coor[1], item.Coor[2]));
            }

            return PtList;
        }


Coordinates(IN[0] as ComAuto, IN[1].ToString())
        ";
# ----------------------------------------
code_block_5 = CodeBlock { "all"; }
code_block_6 = CodeBlock(a=fromString, b=code_block_5) { {a,b}; }
