# Dynamo graph Home.dyn (Dynamo 1.3.0.875)

file_path = Filename("C:\Program Files\Oasys\GSA 8.7\Samples\Stair.gwb")
code_block = CodeBlock()
# ---------- code_block.designscript (14 lines) ----------
"
using Interop.gsa_8_7;

string filePath = IN[0].ToString();
            ComAuto GsaObj = new ComAuto();
            GsaObj.SetLocale(Locale.LOC_EN_GB);
            GsaObj.Open(filePath);

string sList = "all";
int[] NodeRefs = null;

GsaObj

";
# ----------------------------------------
code_block_2 = CodeBlock()
# ---------- code_block_2.designscript (15 lines) ----------
"
using Interop.gsa_8_7;


ComAuto GsaObj = IN[0] as ComAuto;

string sList = IN[1].ToString();

int[] NodeRefs = null;

short s = GsaObj.EntitiesInList(sList, GsaEntity.NODE, out NodeRefs);

NodeRefs

";
# ----------------------------------------
code_block_3 = CodeBlock { a; }  # unwired: a
code_block_4 = CodeBlock { "all"; }
code_block_5 = CodeBlock(a=code_block_3, b=code_block_4) { {a,b}; }
file_path_2 = Filename("C:\Program Files\Oasys\GSA 8.7\Interop.Gsa_8_7.dll")
fromString = Scripting.CSharpScript.FromString(code_block_2, code_block_5, file_path_2)
code_block_6 = CodeBlock()
# ---------- code_block_6.designscript (10 lines) ----------
"
using Interop.gsa_8_7;

string filePath = IN[0].ToString();
            ComAuto GsaObj = new ComAuto();
            GsaObj.SetLocale(Locale.LOC_EN_GB);
            GsaObj.Open(filePath);
GsaObj

";
# ----------------------------------------
file_path_3 = Filename("C:\Program Files\Oasys\GSA 8.7\Interop.Gsa_8_7.dll")
fromString_2 = Scripting.CSharpScript.FromString(code_block_6, arg2=file_path_3)
type = Object.Type(fromString_2)
file_path_4 = Filename("..\..\..\..\..\..\..\Program Files\Oasys\GSA 8.7\Samples\2D_Elements\Cynthia.gwb")
openGsaModel = GSAInOp.GSAInterop.OpenGsaModel(file_path_4)
code_block_7 = CodeBlock { "all"; }
getGsaNodeNumbers = GSAInOp.GSAInterop.GetGsaNodeNumbers(openGsaModel, code_block_7)
openGsaModel_2 = GSAInOp.GSAInterop.OpenGsaModel(file_path_4)
